# Dynamo graph 1. Create 4D Modelling Shared Parameters.dyn "1. New Parameter Assignment" (Dynamo 3.2.2.5494)
# author: Mark McDaid and Frédéric Bosché
# Creates New Shared Parameters Required for 4D Modelling Automation

# group: Input
select_excel_spreadsheet = Filename("..\Example Data\4D-Modelling-Parameters_New.xlsx")  # "Select Excel spreadsheet containing all the 4D modelling data"; graph input

# group: Extract data from the "New_Shared_Parameters" tab
file_from_path = FileObject(path=select_excel_spreadsheet)
string = StringInput("Shared_Parameters")
code_block = CodeBlock { true; false; }
importExcel = Data.ImportExcel(file=file_from_path, sheetName=string, readAsStrings=code_block.out1)
restOfItems = List.RestOfItems(list=importExcel)
transpose = List.Transpose(lists=restOfItems)
code_block_2 = CodeBlock(lst=transpose) { names = lst[0]; groups = lst[1]; spectype = lst[2]; }

# group: SpecTypes Dictionary (extend as needed)
string_2 = StringInput("Text")
string_3 = StringInput("Number")
list_create = List.Create(item0=string_2, item1=string_3)
spec_types = SpecTypes("autodesk.spec:spec.string")
spec_types_2 = SpecTypes("autodesk.spec.aec:number")
list_create_2 = List.Create(item0=spec_types, item1=spec_types_2)
byKeysValues = DesignScript.Builtin.Dictionary.ByKeysValues(keys=list_create, values=list_create_2)
valueAtKey = DesignScript.Builtin.Dictionary.ValueAtKey(dictionary=byKeysValues, key=code_block_2.spectype)

# note: It could be interesting to automatically created a "4D Modelling" groupe
group_types = GroupTypes("autodesk.parameter.group:identityData")
boolean = BoolSelector(true)
createSharedParameterForAllCategories = Parameter.CreateSharedParameterForAllCategories(parameterName=code_block_2.names, groupName=code_block_2.groups, specType=valueAtKey, groupType=group_types, instance=boolean)
