# Dynamo graph 1. New Parameter Assignment.dyn (Dynamo 2.18.1.5096)

# group: Creates 5No. Shared Parameters for 4D Modelling
file_path = Filename("..\Revit\4D Modelling Master (with Macros) .xlsm")
file_from_path = FileObject(path=file_path)
code_block = CodeBlock { "New_Shared_Parameters"; true; true; }
importExcel = Data.ImportExcel(file=file_from_path, sheetName=code_block.out0, readAsStrings=code_block.out1, showExcel=code_block.out2)
restOfItems = List.RestOfItems(list=importExcel)
transpose = List.Transpose(lists=restOfItems)
code_block_2 = CodeBlock(lst=transpose) { sp_names = lst[0]; groups = lst[1]; }
spec_types = SpecTypes("autodesk.spec:spec.string")
group_types = GroupTypes("autodesk.parameter.group:data")
boolean = BoolSelector(true)
createSharedParameterForAllCategories = Parameter.CreateSharedParameterForAllCategories(parameterName=code_block_2.sp_names, groupName=code_block_2.groups, specType=spec_types, groupType=group_types, instance=boolean)
