# Dynamo graph 2. Automatic Parting of Slabs.dyn (Dynamo 3.2.2.5494)
# Creates a Reference Plane Normal to a Selected Grid Line, Creates Parts from Selected Elements and Divides Parts at Reference Plane Location
# packages: Rhythm 2023.9.1

# group: Input
pick_model_elements_to_split = DSModelElementMultipleSelection()  # 4 picked in the model; graph input
select_grid_lines = DSModelElementMultipleSelection()  # 1 picked in the model; graph input

# group: Find Elements that are Parts
getCategory = Element.GetCategory(element=pick_model_elements_to_split)
name = Category.Name(category=getCategory)
string = StringInput("Parts")
eq = name == string
filterByBoolMask = List.FilterByBoolMask(list=pick_model_elements_to_split, mask=eq)

# group: Split elements into parts
ʳʰʸᵗʰᵐ_elements_createparts = Rhythm.Revit.Elements.Elements.CreateParts(element=filterByBoolMask.out)

flatten = List.Flatten(list=ʳʰʸᵗʰᵐ_elements_createparts)
join = List.Join(list0=filterByBoolMask.in, list1=flatten)

# group: Creates Reference Plane for splitting elements
curve = Grid.Curve(grid=select_grid_lines)
startPoint = Curve.StartPoint(curve=curve)
endPoint = Curve.EndPoint(curve=curve)
byStartPointEndPoint = ReferencePlane.ByStartPointEndPoint(start=startPoint, end=endPoint, lacing=Shortest)

# group: Divide parts using Reference Plane
ʳʰʸᵗʰᵐ_parts_divideparts = Rhythm.Revit.Elements.Parts.DivideParts(part=join, referencePlane=byStartPointEndPoint)  # graph output
