# Dynamo graph 3. Zone Value Assignment.dyn (Dynamo 3.2.2.5494)
# Finds Elements Centroid and Assigns Respective Construction Zone Value

# group: Get all Elements with populated Uniclass values
all_elements_in_active_view = ElementsInView()
finds_all_the_elements_parts = Python(IN[0]=all_elements_in_active_view)  # "Finds all the Elements/Parts which are Parents"; CPython3
# ---------- finds_all_the_elements_parts.python (37 lines) ----------
import clr
clr.AddReference('ProtoGeometry')
from Autodesk.DesignScript.Geometry import *
clr.AddReference("RevitNodes")
import Revit
clr.ImportExtensions(Revit.Elements)
clr.ImportExtensions(Revit.GeometryConversion)
clr.AddReference("RevitServices")
import RevitServices
from RevitServices.Persistence import DocumentManager
from RevitServices.Transactions import TransactionManager
from System.Collections.Generic import *
clr.AddReference("RevitAPI")
import Autodesk
from Autodesk.Revit.DB import *

doc = DocumentManager.Instance.CurrentDBDocument
uiapp = DocumentManager.Instance.CurrentUIApplication
app = uiapp.Application

elts = [UnwrapElement(i) for i in IN[0]]

Ids = [e.Id for e in elts]

List = []
for i in Ids:
    a = PartUtils.GetAssociatedParts(doc, i, True, True)
    if a:  # Check if there are associated parts
        Parts = [doc.GetElement(part).ToDSType(True) for part in a]
        List.append(elts[Ids.index(i)])  # Append the original element to the list
    else:
        List.append(None)  # Append None if no associated parts

# Filter out None values
filtered_list = [element for element in List if element is not None]

OUT = filtered_list
# ----------------------------------------
categories = Categories("OST_StructuralColumns")  # frozen
all_elements_of_category = ElementsOfCategory(Category=categories)

# group: Get all Elements with populated Uniclass values > Retain only the elements with a value set for the parameter "Classification_Uniclass_No"
string = StringInput("Classification_Uniclass_No")
getParameterValueByName = Element.GetParameterValueByName(element=all_elements_in_active_view, parameterName=string)
code_block = CodeBlock { ""; }
eq = getParameterValueByName == code_block
filterByBoolMask = List.FilterByBoolMask(list=all_elements_in_active_view, mask=eq)

# group (continued): Get all Elements with populated Uniclass values
contains = List.Contains(list=filterByBoolMask.out, item=finds_all_the_elements_parts, lacing=CrossProduct)
allFalse = List.AllFalse(list=contains@L2)
filterByBoolMask_2 = List.FilterByBoolMask(list=filterByBoolMask.out, mask=allFalse)
watch = Watch(filterByBoolMask_2.in)
watch_2 = Watch(filterByBoolMask.out)

# group: Find Elements with Geometry
solids = Element.Solids(element=filterByBoolMask_2.in)
isEmpty = List.IsEmpty(list=solids@L2)
filterByBoolMask_3 = List.FilterByBoolMask(list=filterByBoolMask_2.in, mask=isEmpty)

# group: Get all Zones
categories_2 = Categories("OST_Mass")
all_elements_of_category_2 = ElementsOfCategory(Category=categories_2)
string_2 = StringInput("Comments")
getParameterValueByName_2 = Element.GetParameterValueByName(element=all_elements_of_category_2, parameterName=string_2)
string_3 = StringInput("Construction Zone")
boolean = BoolSelector(true)
contains_2 = String.Contains(string=getParameterValueByName_2, searchFor=string_3, ignoreCase=boolean)
filterByBoolMask_4 = List.FilterByBoolMask(list=all_elements_of_category_2, mask=contains_2)  # graph output

# group: Get Bounding Boxes of Construction Zones
solids_2 = Element.Solids(element=filterByBoolMask_4.in)
byMinimumVolume = BoundingBox.ByMinimumVolume(geom=solids_2)
byGeometry = BoundingBox.ByGeometry(geom=solids_2)  # frozen

# group: Get Centroids of Elements
filterByBoolMask_5 = List.FilterByBoolMask(list=solids, mask=isEmpty)
flatten = List.Flatten(list=filterByBoolMask_5.out)
centroid = Solid.Centroid(solid=flatten)

# group: Get Elements inside each Construction Zone
contains_3 = BoundingBox.Contains(boundingBox=byMinimumVolume, point=centroid, lacing=CrossProduct)
filterByBoolMask_6 = List.FilterByBoolMask(list=filterByBoolMask_3.out@L2, mask=contains_3, lacing=CrossProduct)
number = DoubleInput(1)
flatten_2 = List.Flatten(list=filterByBoolMask_6.in, amount=number)
watch_3 = Watch(flatten_2)

# group: Get Elements outside all Construction Zones or without Geometry
transpose = List.Transpose(lists=contains_3)
allFalse_2 = List.AllFalse(list=transpose@L2)
filterByBoolMask_7 = List.FilterByBoolMask(list=filterByBoolMask_2.in, mask=allFalse_2)
number_2 = DoubleInput(1)
flatten_3 = List.Flatten(list=filterByBoolMask_7.in, amount=number_2)
list_create = List.Create(item0=filterByBoolMask_3.in, item1=flatten_3)

# group: Finds Elements Centroid and Assigns Respective Construction Zone Value
string_4 = StringInput("Construction_Zone")
name = Element.Name(element=filterByBoolMask_4.in)
setParameterByName = Element.SetParameterByName(element=flatten_2, parameterName=string_4, value=name, lacing=Longest)  # graph output
string_5 = StringInput("")
setParameterByName_2 = Element.SetParameterByName(element=list_create, parameterName=string_4, value=string_5, lacing=Longest)  # graph output

# group: Check
filterByBoolMask_8 = List.FilterByBoolMask(list=centroid, mask=allFalse_2)
watch_3d = Watch3D(byMinimumVolume, filterByBoolMask_8.out)
watch_3d_2 = Watch3D(byMinimumVolume, filterByBoolMask_8.in)

name_2 = Element.Name(element=list_create)
