# Dynamo graph 4. Unique Zones and Levels.dyn "4.0 Unique Zones and Levels" (Dynamo 3.2.2.5494)
# author: Mark McDaid and Frédéric Bosché
# Export Tables of Construction Zones and Levels to Excel Spreadsheet to define the corresponding Sequencing Orders.

# group: Input
file_path = Filename("..\Example Data\4D-Modelling-Parameters_New.xlsx")  # graph input

# group: Get all Zones
categories = Categories("OST_Mass")
all_elements_of_category = ElementsOfCategory(Category=categories)
string = StringInput("Comments")
getParameterValueByName = Element.GetParameterValueByName(element=all_elements_of_category, parameterName=string)
string_2 = StringInput("Construction Zone")
boolean = BoolSelector(true)
contains = String.Contains(string=getParameterValueByName, searchFor=string_2, ignoreCase=boolean)
filterByBoolMask = List.FilterByBoolMask(list=all_elements_of_category, mask=contains)

# group: Create Construction Zones table to be exported
string_3 = StringInput("Construction Zones")
name = Element.Name(element=filterByBoolMask.in)
addItemToFront = List.AddItemToFront(item=string_3, list=name)
count = List.Count(list=addItemToFront)
code_block = CodeBlock(cnt=count) { 0..#cnt..1; }
number = DoubleInput(0)
string_4 = StringInput("Sequencing Order")
replaceItemAtIndex = List.ReplaceItemAtIndex(list=code_block, index=number, item=string_4)
list_create = List.Create(item0=addItemToFront, item1=replaceItemAtIndex)
transpose = List.Transpose(lists=list_create)

# group: Export Construction Zones Data to Excel
string_5 = StringInput("Zone_Seq")
code_block_2 = CodeBlock { 0; 0; true; true; }
exportToExcel = Data.ExportToExcel(filePath=file_path, sheetName=string_5, startRow=code_block_2.out0, startColumn=code_block_2.out1, data=transpose, overWrite=code_block_2.out2, writeAsString=code_block_2.out3)

# group: Get all Levels
categories_2 = Categories("OST_Levels")
all_elements_of_category_2 = ElementsOfCategory(Category=categories_2)

# group: Create Levels Table to be exported
string_6 = StringInput("Levels")
name_2 = Level.Name(level=all_elements_of_category_2)
addItemToFront_2 = List.AddItemToFront(item=string_6, list=name_2)
count_2 = List.Count(list=addItemToFront_2)
code_block_3 = CodeBlock(cnt=count_2) { 0..#cnt..1; }
number_2 = DoubleInput(0)
string_7 = StringInput("Sequencing Order")
replaceItemAtIndex_2 = List.ReplaceItemAtIndex(list=code_block_3, index=number_2, item=string_7)
list_create_2 = List.Create(item0=addItemToFront_2, item1=replaceItemAtIndex_2)
transpose_2 = List.Transpose(lists=list_create_2)

# group: Export Levels Data to Excel
string_8 = StringInput("Level_Seq")
code_block_4 = CodeBlock { 0; 0; true; true; }
exportToExcel_2 = Data.ExportToExcel(filePath=file_path, sheetName=string_8, startRow=code_block_4.out0, startColumn=code_block_4.out1, data=transpose_2, overWrite=code_block_4.out2, writeAsString=code_block_4.out3)

# group: Output
output_export_construction_zones = Watch(exportToExcel)
output_export_levels = Watch(exportToExcel_2)
