# Dynamo graph 5. Construction Sequencing and Final Schedule.dyn (Dynamo 3.2.2.5494)
# author: Mark McDaid and Frédéric Bosché
# Create Construction Schedule from Spreadsheet Data on Activities, Related Elements, as well as the sequencing over Construction Zones and Levels.

# group: Get all Elements without parents with populated Uniclass values
categories = Categories("OST_Walls")  # frozen
all_elements_of_category = ElementsOfCategory(Category=categories)
all_elements_in_active_view = ElementsInView()
finds_all_the_elements_parts = Python(IN[0]=all_elements_in_active_view)  # "Finds all the Elements/Parts which are Parents"; CPython3
# ---------- finds_all_the_elements_parts.python (37 lines) ----------
import clr
clr.AddReference('ProtoGeometry')
from Autodesk.DesignScript.Geometry import *
clr.AddReference("RevitNodes")
import Revit
clr.ImportExtensions(Revit.Elements)
clr.ImportExtensions(Revit.GeometryConversion)
clr.AddReference("RevitServices")
import RevitServices
from RevitServices.Persistence import DocumentManager
from RevitServices.Transactions import TransactionManager
from System.Collections.Generic import *
clr.AddReference("RevitAPI")
import Autodesk
from Autodesk.Revit.DB import *

doc = DocumentManager.Instance.CurrentDBDocument
uiapp = DocumentManager.Instance.CurrentUIApplication
app = uiapp.Application

elts = [UnwrapElement(i) for i in IN[0]]

Ids = [e.Id for e in elts]

List = []
for i in Ids:
    a = PartUtils.GetAssociatedParts(doc, i, True, True)
    if a:  # Check if there are associated parts
        Parts = [doc.GetElement(part).ToDSType(True) for part in a]
        List.append(elts[Ids.index(i)])  # Append the original element to the list
    else:
        List.append(None)  # Append None if no associated parts

# Filter out None values
filtered_list = [element for element in List if element is not None]

OUT = filtered_list
# ----------------------------------------

# group: Get all Elements without parents with populated Uniclass values > Get all Elements with populated Uniclass values
string = StringInput("Classification_Uniclass_No")
getParameterValueByName = Element.GetParameterValueByName(element=all_elements_in_active_view, parameterName=string)
code_block = CodeBlock { ""; }
eq = getParameterValueByName == code_block
filterByBoolMask = List.FilterByBoolMask(list=all_elements_in_active_view, mask=eq)
watch = Watch(filterByBoolMask.out)

# group: Get all Elements without parents with populated Uniclass values > Remove parents from list of elements
contains = List.Contains(list=filterByBoolMask.out, item=finds_all_the_elements_parts, lacing=CrossProduct)
allFalse = List.AllFalse(list=contains@L2)
filterByBoolMask_2 = List.FilterByBoolMask(list=filterByBoolMask.out, mask=allFalse)
watch_2 = Watch(filterByBoolMask_2.in)

# group: Input
select_the_spreadsheeting = Filename("..\Example Data\4D-Modelling-Parameters_New.xlsx")  # "Select the Spreadsheeting containing the 4D Modelling data"; graph input
file_from_path = FileObject(path=select_the_spreadsheeting)

# group: Get Construction Zone Construction Sequence table
string_2 = StringInput("Zone_Seq")
code_block_2 = CodeBlock { true; false; }
importExcel = Data.ImportExcel(file=file_from_path, sheetName=string_2, readAsStrings=code_block_2.out0, showExcel=code_block_2.out1)
restOfItems = List.RestOfItems(list=importExcel)
transpose = List.Transpose(lists=restOfItems)
code_block_3 = CodeBlock { 0; }
getItemAtIndex = List.GetItemAtIndex(list=transpose, index=code_block_3)
code_block_4 = CodeBlock { 1; }
getItemAtIndex_2 = List.GetItemAtIndex(list=transpose, index=code_block_4)
byKeysValues = DesignScript.Builtin.Dictionary.ByKeysValues(keys=getItemAtIndex, values=getItemAtIndex_2)

# group: Get Element's Construction Zone Construction Sequence Value
string_3 = StringInput("Construction_Zone")
getParameterValueByName_2 = Element.GetParameterValueByName(element=filterByBoolMask_2.in, parameterName=string_3)
valueAtKey = DesignScript.Builtin.Dictionary.ValueAtKey(dictionary=byKeysValues, key=getParameterValueByName_2)

# group: Get Level Construction Sequence table
string_4 = StringInput("Level_Seq")
code_block_5 = CodeBlock { true; false; }
importExcel_2 = Data.ImportExcel(file=file_from_path, sheetName=string_4, readAsStrings=code_block_5.out0, showExcel=code_block_5.out1)
restOfItems_2 = List.RestOfItems(list=importExcel_2)
transpose_2 = List.Transpose(lists=restOfItems_2)
code_block_6 = CodeBlock { 0; }
getItemAtIndex_3 = List.GetItemAtIndex(list=transpose_2, index=code_block_6)
code_block_7 = CodeBlock { 1; }
getItemAtIndex_4 = List.GetItemAtIndex(list=transpose_2, index=code_block_7)
byKeysValues_2 = DesignScript.Builtin.Dictionary.ByKeysValues(keys=getItemAtIndex_3, values=getItemAtIndex_4)

# group: Get Element's Level Construction Sequence Value
string_5 = StringInput("Base Level")
getParameterValueByName_3 = Element.GetParameterValueByName(element=filterByBoolMask_2.in, parameterName=string_5)
string_6 = StringInput("Reference Level")
getParameterValueByName_4 = Element.GetParameterValueByName(element=filterByBoolMask_2.in, parameterName=string_6)
string_7 = StringInput("Level")
getParameterValueByName_5 = Element.GetParameterValueByName(element=filterByBoolMask_2.in, parameterName=string_7)
python_script = Python(IN[0]=getParameterValueByName_3, IN[1]=getParameterValueByName_4, IN[2]=getParameterValueByName_5)  # CPython3
# ---------- python_script.python (26 lines) ----------
# Load the Python Standard and DesignScript Libraries
import sys
import clr
clr.AddReference('ProtoGeometry')
from Autodesk.DesignScript.Geometry import *

# Define your three lists
list1 = IN[0]
list2 = IN[1]
list3 = IN[2]

# Initialize an empty result list
result_list = []

# Iterate through the indices of the lists
for i in range(len(list1)):
    # Check if the value exists in list1, list2, or list3
    if list1[i]:
        result_list.append(list1[i])
    elif list2[i]:
        result_list.append(list2[i])
    else:  # No need for the else block if you are sure there will be a value in one of the lists
        result_list.append(list3[i])

# Output the result list
OUT = result_list
# ----------------------------------------
name = Level.Name(level=python_script)
valueAtKey_2 = DesignScript.Builtin.Dictionary.ValueAtKey(dictionary=byKeysValues_2, key=name)

# group: Get Element Construction Sequence table
string_8 = StringInput("Construction_Seq")
code_block_8 = CodeBlock { true; false; }
importExcel_3 = Data.ImportExcel(file=file_from_path, sheetName=string_8, readAsStrings=code_block_8.out0, showExcel=code_block_8.out1)
restOfItems_3 = List.RestOfItems(list=importExcel_3)
transpose_3 = List.Transpose(lists=restOfItems_3)
code_block_9 = CodeBlock(a=transpose_3) { a[1]; a[2]; }
byKeysValues_3 = DesignScript.Builtin.Dictionary.ByKeysValues(keys=code_block_9.out0, values=code_block_9.out1)

# group: Get Element's Element Construction Sequence Value
string_9 = StringInput("Classification_Uniclass_No")
getParameterValueByName_6 = Element.GetParameterValueByName(element=filterByBoolMask_2.in, parameterName=string_9)
valueAtKey_3 = DesignScript.Builtin.Dictionary.ValueAtKey(dictionary=byKeysValues_3, key=getParameterValueByName_6)

# group: Remove Elements that have Null Zone, Level, or Construction Sequence Values
isNull = Object.IsNull(object=valueAtKey)
isNull_2 = Object.IsNull(object=valueAtKey_2)
isNull_3 = Object.IsNull(object=valueAtKey_3)
code_block_10 = CodeBlock(a=isNull, b=isNull_2, c=isNull_3) { a || b || c; }
filterByBoolMask_3 = List.FilterByBoolMask(list=filterByBoolMask_2.in, mask=code_block_10)
filterByBoolMask_4 = List.FilterByBoolMask(list=valueAtKey, mask=code_block_10)
filterByBoolMask_5 = List.FilterByBoolMask(list=valueAtKey_2, mask=code_block_10)
filterByBoolMask_6 = List.FilterByBoolMask(list=valueAtKey_3, mask=code_block_10)

# group: Set 4D_Task_ID parameter of each Element
string_10 = StringInput("4D_Task_ID")
python_script_2 = Python(IN[0]=filterByBoolMask_4.out, IN[1]=filterByBoolMask_5.out, IN[2]=filterByBoolMask_6.out)  # CPython3
# ---------- python_script_2.python (18 lines) ----------
# Load the Python Standard and DesignScript Libraries
import sys
import clr
clr.AddReference('ProtoGeometry')
from Autodesk.DesignScript.Geometry import *

# Example input lists (replace these with your actual lists)
list1 = IN[0]  # List 1 with numbers like "01", "02", ...
list2 = IN[1]  # List 2 with numbers like "03", "04", ...
list3 = IN[2]  # List 3 with numbers like "05", "06", ...

# Check if all lists have the same length
if len(set(map(len, [list1, list2, list3]))) == 1:
    # Combine values from all lists at each index
    combined_values = ["".join(values) for values in zip(list1, list2, list3)]
    OUT = combined_values
else:
    OUT = "Error: Lists have different lengths."
# ----------------------------------------
setParameterByName = Element.SetParameterByName(element=filterByBoolMask_3.out, parameterName=string_10, value=python_script_2)

# group: Get dictionary listing all Elements associated to each Activity
# note: Now saving the data in the Spreadsheet. Process is split into:
# • Sorted list of Activity 4D-Task_ID values
# • Elements for each Activity
# • Calculates Count, Volume, Area and Duration for each Activity.
# •  Save table in Excel
python_script_3 = Python(IN[0]=setParameterByName)  # CPython3
# ---------- python_script_3.python (38 lines) ----------
# Load the Python Standard and DesignScript Libraries
import sys
import clr
clr.AddReference('ProtoGeometry')
from Autodesk.DesignScript.Geometry import *

# Dynamo Script to Group Elements by 4D_Task_ID Parameter
# Input parameters
fourD_Task_ID_parameter_name = "4D_Task_ID"  # Replace with the actual name of the 4D_Task_ID parameter

# Initialize an empty dictionary to store grouped elements
grouped_elements_dict = {}
ID_list = []

element_list = IN[0]

# Iterate through all elements in the model
for element in element_list:
    # Get the value of the 4D_Task_ID parameter for the current element
    fourD_Task_ID_value = element.GetParameterValueByName(fourD_Task_ID_parameter_name)

    # Check if the 4D_Task_ID_value is not None
    if fourD_Task_ID_value is not None:
        # Check if the 4D_Task_ID_value is already a key in the dictionary
        if fourD_Task_ID_value in grouped_elements_dict:
            # Append the current element to the list corresponding to the 4D_Task_ID_value key
            grouped_elements_dict[fourD_Task_ID_value].append(element)
        else:
            # Create a new list with the current element and assign it to the 4D_Task_ID_value key
            grouped_elements_dict[fourD_Task_ID_value] = [element]
            #ID_list.append(fourD_Task_ID_value)

# Convert the dictionary values to a list of sublists
grouped_elements = list(grouped_elements_dict.values())

# Output the list of grouped elements
OUT = grouped_elements_dict
#OUT = [grouped_elements,ID_list]
# ----------------------------------------

# group: Get list of Activity UniqueIDs
keys = DesignScript.Builtin.Dictionary.Keys(dictionary=python_script_3)
sorted_list_activity_uniqueids = List.Sort(list=keys)

# group: Get Productivity Units and Values from "Construction_Seq" tab in spreadsheet
string_11 = StringInput("Construction_Seq")
code_block_11 = CodeBlock { false; false; }
importExcel_4 = Data.ImportExcel(file=file_from_path, sheetName=string_11, readAsStrings=code_block_11.out1)
restOfItems_4 = List.RestOfItems(list=importExcel_4)
transpose_4 = List.Transpose(lists=restOfItems_4)
code_block_12 = CodeBlock(a=transpose_4) { a[1]; a[5]; a[3]; a[0]; }
byKeysValues_4 = DesignScript.Builtin.Dictionary.ByKeysValues(keys=code_block_12.out0, values=code_block_12.out3)
byKeysValues_5 = DesignScript.Builtin.Dictionary.ByKeysValues(keys=code_block_12.out0, values=code_block_12.out1)
byKeysValues_6 = DesignScript.Builtin.Dictionary.ByKeysValues(keys=code_block_12.out0, values=code_block_12.out2)

# group: Compute list of Element Uniclass IDs for each Activity
valueAtKey_4 = DesignScript.Builtin.Dictionary.ValueAtKey(dictionary=python_script_3, key=sorted_list_activity_uniqueids)
string_12 = StringInput("Classification_Uniclass_No")
getParameterValueByName_7 = Element.GetParameterValueByName(element=valueAtKey_4, parameterName=string_12)
firstItem = List.FirstItem(list=getParameterValueByName_7@L2)

# group: Compute list of Activity Names
valueAtKey_5 = DesignScript.Builtin.Dictionary.ValueAtKey(dictionary=byKeysValues_4, key=firstItem)

# group: Compute list of Element Counts
list_of_element_counts = List.Count(list=getParameterValueByName_7@L2)

# group: Compute list of Volumnes
valueAtKey_6 = DesignScript.Builtin.Dictionary.ValueAtKey(dictionary=python_script_3, key=sorted_list_activity_uniqueids)
string_13 = StringInput("Volume")
getParameterValueByName_8 = Element.GetParameterValueByName(element=valueAtKey_6, parameterName=string_13)
sum = Math.Sum(values=getParameterValueByName_8@L2)

# group: Compute list of Areas
valueAtKey_7 = DesignScript.Builtin.Dictionary.ValueAtKey(dictionary=python_script_3, key=sorted_list_activity_uniqueids)
string_14 = StringInput("Area")
getParameterValueByName_9 = Element.GetParameterValueByName(element=valueAtKey_7, parameterName=string_14)
sum_2 = Math.Sum(values=getParameterValueByName_9@L2)

# group: Calculate Duration > Get Productivity Units
valueAtKey_8 = DesignScript.Builtin.Dictionary.ValueAtKey(dictionary=byKeysValues_5, key=firstItem)

# group: Calculate Duration > Get Productivity Value
valueAtKey_9 = DesignScript.Builtin.Dictionary.ValueAtKey(dictionary=byKeysValues_6, key=firstItem)

# group: Calculate Duration > Input
set_working_hours_in_working_day = DoubleSlider(10, range=1..24 step 0.5)  # graph input

# group: Calculate Duration > Calculate Duration from Volume
string_15 = StringInput("item")
eq_2 = valueAtKey_8 == string_15
code_block_13 = CodeBlock(quantity=list_of_element_counts, unit_productivity=valueAtKey_9, hours_per_day=set_working_hours_in_working_day) { duration_days = quantity * unit_productivity / hours_per_day; }
number = DoubleInput(0)
if_ = RefactoredIf(test=eq_2, true=code_block_13, false=number, lacing=Longest)

# group: Calculate Duration > Calculate Duration from Volume
string_16 = StringInput("cubic metre")
eq_3 = valueAtKey_8 == string_16
code_block_14 = CodeBlock(quantity=sum, unit_productivity=valueAtKey_9, hours_per_day=set_working_hours_in_working_day) { duration_days = quantity * unit_productivity / hours_per_day; }
number_2 = DoubleInput(0)
if_2 = RefactoredIf(test=eq_3, true=code_block_14, false=number_2, lacing=Longest)

# group: Calculate Duration > Calculate Duration from Area
string_17 = StringInput("square metre")
eq_4 = valueAtKey_8 == string_17
code_block_15 = CodeBlock(quantity=sum_2, unit_productivity=valueAtKey_9, hours_per_day=set_working_hours_in_working_day) { duration_days = quantity * unit_productivity / hours_per_day; }
number_3 = DoubleInput(0)
if_3 = RefactoredIf(test=eq_4, true=code_block_15, false=number_3, lacing=Longest)

# group: Calculate Duration
max = Math.Max(value1=if_2, value2=if_3)
max_2 = Math.Max(value1=if_, value2=max)

# group: Define Activity IDs
code_block_16 = CodeBlock { 1; }
count = List.Count(list=sorted_list_activity_uniqueids)
range = Range(start=code_block_16, end=count)

# group: Define Predecessor IDs
code_block_17 = CodeBlock(a=range) { b = a -1; }

# group: Create Table and Save in Excel
code_block_18 = CodeBlock { ["Sequence ID", "Name", "Uniclass", "Number of Items","m^3","m^2","Duration","ID","Predecessor ID"]; }
list_create = List.Create(item0=sorted_list_activity_uniqueids)
list_create_2 = List.Create(item0=valueAtKey_5)
list_create_3 = List.Create(item0=firstItem)
list_create_4 = List.Create(item0=list_of_element_counts)
list_create_5 = List.Create(item0=sum)
list_create_6 = List.Create(item0=sum_2)
list_create_7 = List.Create(item0=max_2)
list_create_8 = List.Create(item0=range)
list_create_9 = List.Create(item0=code_block_17)
join = List.Join(list0=list_create, list1=list_create_2, list2=list_create_3, list3=list_create_4, list4=list_create_5, list5=list_create_6, list6=list_create_7, list7=list_create_8, list8=list_create_9)
transpose_5 = List.Transpose(lists=join)
addItemToFront = List.AddItemToFront(item=code_block_18, list=transpose_5)
watch_3 = Watch(addItemToFront)
string_18 = StringInput("Generated_Schedule")
code_block_19 = CodeBlock { 0; 0; }
code_block_20 = CodeBlock { true; true; }
exportToExcel = Data.ExportToExcel(filePath=select_the_spreadsheeting, sheetName=string_18, startRow=code_block_19.out0, startColumn=code_block_19.out1, data=addItemToFront, overWrite=code_block_20.out0, writeAsString=code_block_20.out1)

string_19 = StringInput("item")
