# Dynamo graph 6. 4D Task ID Assignment, Information Population and Final Schedule.dyn (Dynamo 2.18.1.5096)
# packages: SteamNodes 1.2.4, Bakery 2019.5.8

all_elements_in_active_view = ElementsInView()
getParts = Custom[Element.GetParts](Elements=all_elements_in_active_view)  # package SteamNodes; Get parts for the elements from Input. Returns Parts and Parent elements
flatten = List.Flatten(list=getParts.Parts)
getParts_2 = Custom[Element.GetParts](Elements=flatten)
string_from_object = FromObject(object=all_elements_in_active_view)
code_block = CodeBlock { "PartMaker"; }
contains = String.Contains(string=string_from_object, searchFor=code_block)
filterByBoolMask = List.FilterByBoolMask(list=all_elements_in_active_view, mask=contains)
string_from_object_2 = FromObject(object=filterByBoolMask.out)
code_block_2 = CodeBlock { "Part"; }
contains_2 = String.Contains(string=string_from_object_2, searchFor=code_block_2)
filterByBoolMask_2 = List.FilterByBoolMask(list=filterByBoolMask.out, mask=contains_2)
remove_list_from_list_by_item = Custom[Remove List from List by Item not Value](ListOfItemsToRemove=getParts_2.Parents, ListToRemoveFrom=filterByBoolMask_2.in)  # package Bakery; remove the items in ListA from the items in ListB and return whats left
parameters = Element.Parameters(element=remove_list_from_list_by_item.reducedList)
file_path = Filename("..\Test for Final Sequencing output .csv")
code_block_3 = CodeBlock { "Test for Final Sequencing outpu"; 1; 0; }
code_block_4 = CodeBlock { "Construction_Zone_Sequence"; "Level_Construction_Sequence"; "Element_Construction_Sequence"; "4D_Task_ID"; }
getParameterValueByName = Element.GetParameterValueByName(element=remove_list_from_list_by_item.reducedList, parameterName=code_block_4.out0)
getParameterValueByName_2 = Element.GetParameterValueByName(element=remove_list_from_list_by_item.reducedList, parameterName=code_block_4.out1)
getParameterValueByName_3 = Element.GetParameterValueByName(element=remove_list_from_list_by_item.reducedList, parameterName=code_block_4.out2)
code_block_5 = CodeBlock(x=getParameterValueByName, y=getParameterValueByName_2, z=getParameterValueByName_3) { x + '.' + y + '.' + z; }
setParameterByName = Element.SetParameterByName(element=remove_list_from_list_by_item.reducedList, parameterName=code_block_4.out3, value=code_block_5)
python_script_sorts_elements = Python(IN[0]=setParameterByName)  # "Python Script: Sorts Elements into Increasing 4D_Task_ID number"; CPython3
# ---------- python_script_sorts_elements.python (19 lines) ----------
# Load the Python Standard and DesignScript Libraries
import sys
import clr
clr.AddReference('ProtoGeometry')
from Autodesk.DesignScript.Geometry import *

# Input: Your list of elements, each containing a 4D task id parameter
elements_with_task_ids = IN[0]

# Define a function for natural sorting
def natural_sort_key(element):
    task_id = element.GetParameterValueByName("4D_Task_ID")
    return [int(part) if part.isdigit() else part for part in task_id.split('.')]

# Sort the elements using the natural sort key function
sorted_elements = sorted(elements_with_task_ids, key=natural_sort_key)

# Output the sorted list of elements
OUT = sorted_elements
# ----------------------------------------
code_block_6 = CodeBlock { "4D_Task_ID"; "Classification_Uniclass_Description"; }
getParameterValueByName_4 = Element.GetParameterValueByName(element=python_script_sorts_elements, parameterName=code_block_6.out0)
getParameterValueByName_5 = Element.GetParameterValueByName(element=python_script_sorts_elements, parameterName=code_block_6.out1)
list_create = List.Create(item0=getParameterValueByName_4, item1=getParameterValueByName_5)
transpose = List.Transpose(lists=list_create)
uniqueItems = List.UniqueItems(list=transpose)
transpose_2 = List.Transpose(lists=uniqueItems)
code_block_7 = CodeBlock { "  &  "; }
python_script = Python(IN[0]=python_script_sorts_elements)  # CPython3
# ---------- python_script.python (35 lines) ----------
# Load the Python Standard and DesignScript Libraries
import sys
import clr
clr.AddReference('ProtoGeometry')
from Autodesk.DesignScript.Geometry import *

# Dynamo Script to Group Elements by 4D_Task_ID Parameter
# Input parameters
fourD_Task_ID_parameter_name = "4D_Task_ID"  # Replace with the actual name of the 4D_Task_ID parameter

# Initialize an empty dictionary to store grouped elements
grouped_elements_dict = {}

Elements = IN[0]

# Iterate through all elements in the model
for element in Elements:
    # Get the value of the 4D_Task_ID parameter for the current element
    fourD_Task_ID_value = element.GetParameterValueByName(fourD_Task_ID_parameter_name)

    # Check if the 4D_Task_ID_value is not None
    if fourD_Task_ID_value is not None:
        # Check if the 4D_Task_ID_value is already a key in the dictionary
        if fourD_Task_ID_value in grouped_elements_dict:
            # Append the current element to the list corresponding to the 4D_Task_ID_value key
            grouped_elements_dict[fourD_Task_ID_value].append(element)
        else:
            # Create a new list with the current element and assign it to the 4D_Task_ID_value key
            grouped_elements_dict[fourD_Task_ID_value] = [element]

# Convert the dictionary values to a list of sublists
grouped_elements = list(grouped_elements_dict.values())

# Output the list of grouped elements
OUT = grouped_elements
# ----------------------------------------
python_script_2 = Python(IN[0]=python_script)  # CPython3
# ---------- python_script_2.python (35 lines) ----------
# Load the Python Standard and DesignScript Libraries
import sys
import clr
clr.AddReference('ProtoGeometry')
from Autodesk.DesignScript.Geometry import *

# Dynamo Script to Extract Task_Construction_Sequence values for Each 4D_Task_ID Sublist
# Input parameters
grouped_elements = IN[0]  # List of sublists grouped by 4D_Task_ID
sequence_parameter_name = "Task_Construction_Sequence"  # Replace with the actual name of the sequence parameter

# Initialize an empty list to store results
unique_sequence_values_lists = []

# Iterate through each sublist in the grouped_elements list
for sublist in grouped_elements:
    # Initialize a set to store unique sequence values for the current sublist
    unique_sequence_values_set = set()

    # Iterate through each element in the sublist
    for element in sublist:
        # Get the sequence parameter value for the current element
        sequence_value = element.GetParameterValueByName(sequence_parameter_name)

        # Check if sequence_value is not None (to handle potential null values)
        if sequence_value is not None:
            # Add the sequence_value to the set to ensure uniqueness
            unique_sequence_values_set.add(sequence_value)

    # Convert the set to a list and append it to the result list for the current sublist
    unique_sequence_values_list = list(unique_sequence_values_set)
    unique_sequence_values_lists.append(unique_sequence_values_list)

# Output the list of unique Task_Construction_Sequence values for each group
OUT = unique_sequence_values_lists
# ----------------------------------------
join = String.Join(separator=code_block_7, string0=python_script_2)
python_script_3 = Python(IN[0]=python_script)  # CPython3
# ---------- python_script_3.python (34 lines) ----------
# Load the Python Standard and DesignScript Libraries
import sys
import clr
clr.AddReference('ProtoGeometry')
from Autodesk.DesignScript.Geometry import *

# Dynamo Script to Calculate Total Volume for Each 4D_Task_ID Sublist
# Input parameters
grouped_elements = IN[0]  # List of sublists grouped by 4D_Task_ID
volume_parameter_name = "Volume"  # Replace with the actual name of the volume parameter

# Initialize an empty list to store results
total_volumes = []

# Iterate through each sublist in the grouped_elements list
for sublist in grouped_elements:
    # Initialize total volume for the current sublist
    total_volume = 0

    # Iterate through each element in the sublist
    for element in sublist:
        # Get the volume parameter value for the current element
        volume_value = element.GetParameterValueByName(volume_parameter_name)

        # Check if volume_value is not None (to handle potential null values)
        if volume_value is not None:
            # Add the volume to the total_volume
            total_volume += volume_value

    # Append the total_volume to the result list for the current sublist
    total_volumes.append(total_volume)

# Output the list of total volumes for each 4D_Task_ID sublist
OUT = total_volumes
# ----------------------------------------
python_script_4 = Python(IN[0]=python_script_3)  # CPython3
# ---------- python_script_4.python (24 lines) ----------
# Load the Python Standard and DesignScript Libraries
import sys
import clr
clr.AddReference('ProtoGeometry')
from Autodesk.DesignScript.Geometry import *

# Import necessary Dynamo libraries
import clr
clr.AddReference('RevitAPI')
from Autodesk.Revit.DB import *

# Input parameter
input_list = IN[0]  # The input list to be chopped

# Function to chop the list into sublists with dynamic length
def chop_list(input_list):
    chunk_size = len(input_list)
    return [input_list[i:i + chunk_size] for i in range(0, len(input_list), chunk_size)]

# Execute the function
output_list = chop_list(input_list)

# Output the result
OUT = output_list
# ----------------------------------------
code_block_8 = CodeBlock(x=join, y=python_script_4) { x + "-" + " Total Volume = " + y +"m3"; }
join_2 = List.Join(list0=transpose_2, list1=code_block_8)
transpose_3 = List.Transpose(lists=join_2)
exportToExcel = Data.ExportToExcel(filePath=file_path, sheetName=code_block_3.out0, startRow=code_block_3.out1, startColumn=code_block_3.out2, data=transpose_3)
file_path_2 = Filename("..\Revit\Test for Final Sequencing output .xlsx")
code_block_9 = CodeBlock { "Sheet1"; 1; 0; }
