# Dynamo graph 1. New Parameter Assignment.dyn (Dynamo 2.19.3.6394)

# group: Creates New Shared Parameters Required for 4D Modelling Automation
file_path = Filename(".\Final Construction Template.xlsx")
file_from_path = FileObject(path=file_path)
code_block = CodeBlock { "New_Shared_Parameters"; true; false; }
importExcel = Data.ImportExcel(file=file_from_path, sheetName=code_block.out0, readAsStrings=code_block.out1, showExcel=code_block.out2)
restOfItems = List.RestOfItems(list=importExcel)
transpose = List.Transpose(lists=restOfItems)
code_block_2 = CodeBlock(lst=transpose) { names = lst[0]; groups = lst[1]; }
spec_types = SpecTypes("autodesk.spec:spec.string")
group_types = GroupTypes("autodesk.parameter.group:identityData")
boolean = BoolSelector(true)
createSharedParameterForAllCategories = Parameter.CreateSharedParameterForAllCategories(parameterName=code_block_2.names, groupName=code_block_2.groups, specType=spec_types, groupType=group_types, instance=boolean)
