# Dynamo graph 2. Automatic Parting of Slabs_old.dyn "2. Automatic Parting of Slabs" (Dynamo 3.2.2.5494)
# Creates a Reference Plane Normal to a Selected Grid Line, Creates Parts from Selected Elements and Divides Parts at Reference Plane Location
# packages: GenerativeDesign.Revit 6.1.1.0, Rhythm 2023.9.1

# group: Input
select_multiple_model_elements = DSModelElementMutlipleSelection()  # 1 picked in the model; graph input
select_grid_line = DSModelElementMutlipleSelection()  # 1 picked in the model; graph input

# group: Split elements into parts
ʳʰʸᵗʰᵐ_elements_createparts = Rhythm.Revit.Elements.Elements.CreateParts(element=select_multiple_model_elements)

# group: Creates Reference Plane for splitting elements
python_script = Python(IN[0]=select_grid_line)  # CPython3
# ---------- python_script.python (20 lines) ----------
# Import necessary namespaces
import clr
clr.AddReference('RevitAPI')
from Autodesk.Revit.DB import *
clr.AddReference('RevitNodes')
import Revit
clr.ImportExtensions(Revit.Elements)
clr.ImportExtensions(Revit.GeometryConversion)
from Autodesk.DesignScript.Geometry import *

# Unwrap the Revit grid line element
gridLine = UnwrapElement(IN[0])

# Get the curve of the grid line
revitCurve = gridLine.Curve

# Convert the Revit curve to Dynamo curve
dynamoCurve = revitCurve.ToProtoType()

OUT = dynamoCurve
# ----------------------------------------
endPoint = Curve.EndPoint(curve=python_script)
startPoint = Curve.StartPoint(curve=python_script)
byStartPointEndPoint = ReferencePlane.ByStartPointEndPoint(start=endPoint, end=startPoint)

# group: Divide parts using Reference Plane
ʳʰʸᵗʰᵐ_parts_divideparts = Rhythm.Revit.Elements.Parts.DivideParts(part=ʳʰʸᵗʰᵐ_elements_createparts, referencePlane=byStartPointEndPoint)
