# Dynamo graph 2. Zone Value Assignment.dyn (Dynamo 2.18.1.5096)
# packages: Crumple 2022.5.27

# group: Finds Elements Centroid and Assigns Respective Construction Zone Value
categories = Categories("OST_Mass")
current = Document.Current()
activeView = Document.ActiveView(document=current)
all_elements_of_category_in_view = ElementsOfCategoryInView(Category=categories, View=activeView)
solids = Element.Solids(element=all_elements_of_category_in_view)
byMinimumVolume = BoundingBox.ByMinimumVolume(geom=solids)
string = StringInput("Parts")
byName = Category.ByName(name=string)
all_elements_of_category = ElementsOfCategory(Category=byName)
elements_centroid = Custom[© Elements.Centroid](element=all_elements_of_category)  # package Crumple; Returns the centroid of the element's axis-aligned bounding box.
contains = BoundingBox.Contains(boundingBox=byMinimumVolume@L1, point=elements_centroid)
python_script_bool_check = Python(IN[0]=contains)  # CPython3
# ---------- python_script_bool_check.python (21 lines) ----------
# Load the Python Standard and DesignScript Libraries
import sys
import clr
clr.AddReference('ProtoGeometry')
from Autodesk.DesignScript.Geometry import *

# The inputs to this node will be stored as a list in the IN variables.
dataEnteringNode = IN

# Place your code below this line
filtered = IN[0]

for i in range(len(filtered[0])):
    val1 = filtered[0][i]
    val2 = filtered[1][i]
    if val1 == val2: 
        message = 'error'
    else: 
        message = 'success'
# Assign your output to the OUT variable.
OUT = message
# ----------------------------------------
python_script_filter_elements = Python(IN[0]=all_elements_of_category, IN[1]=contains)  # "Python Script: Filter elements based on boolean values for the scope boxes"; CPython3
# ---------- python_script_filter_elements.python (22 lines) ----------
# Load the Python Standard and DesignScript Libraries
import sys
import clr
clr.AddReference('ProtoGeometry')
from Autodesk.DesignScript.Geometry import *
from itertools import compress

# The inputs to this node will be stored as a list in the IN variables.
dataEnteringNode = IN

# Place your code below this line
elements = IN[0]
boolean_lists = IN[1]

#create lists for filtered elements based on category
category_filtered = []
for i in range(len(boolean_lists)):
    category_filtered.append([])
for i in range(len(boolean_lists)):
    category_filtered[i] = list(compress(elements, boolean_lists[i]))
# Assign your output to the OUT variable.
OUT = category_filtered
# ----------------------------------------
code_block = CodeBlock { "Construction_Zone"; }
code_block_2 = CodeBlock(x=all_elements_of_category_in_view) { x.Name; }
setParameterByName = Element.SetParameterByName(element=python_script_filter_elements, parameterName=code_block, value=code_block_2)
watch = Watch(setParameterByName)
