# Dynamo graph 3. Zones, Levels & Uniclass Descriptions Excel Export.dyn "3. Unique Zones and Uniclass Descriptions" (Dynamo 2.18.1.5096)

# group: Finds All Unique Elements in Model Using Uniclass Descriptions and Exports to Excel
file_path = Filename("..\Revit\4D Modelling Master (with Macros) .xlsm")
code_block = CodeBlock { "Model_Elements_Seq"; 1; 0; false; true; }
string = StringInput("Parts")
byName = Category.ByName(name=string)
all_elements_of_category = ElementsOfCategory(Category=byName)
code_block_2 = CodeBlock { "Classification_Uniclass_Description"; }
getParameterValueByName = Element.GetParameterValueByName(element=all_elements_of_category, parameterName=code_block_2)
groupByKey = List.GroupByKey(list=all_elements_of_category, keys=getParameterValueByName)
exportToExcel = Data.ExportToExcel(filePath=file_path, sheetName=code_block.out0, startRow=code_block.out1, startColumn=code_block.out2, data=groupByKey.uniqueKeys, overWrite=code_block.out3, writeAsString=code_block.out4)
watch = Watch(groupByKey.uniqueKeys)

# group: Finds All Construction Zones in Model and Exports to Excel
file_path_2 = Filename("..\Revit\4D Modelling Master (with Macros) .xlsm")
code_block_3 = CodeBlock { "Construction_Zone_Seq"; 1; 0; false; true; }
categories = Categories("OST_Mass")
all_elements_of_category_2 = ElementsOfCategory(Category=categories)
exportToExcel_2 = Data.ExportToExcel(filePath=file_path_2, sheetName=code_block_3.out0, startRow=code_block_3.out1, startColumn=code_block_3.out2, data=all_elements_of_category_2, overWrite=code_block_3.out3, writeAsString=code_block_3.out4)

# group: Finds All Levels in Model and Exports to Excel
file_path_3 = Filename("..\Revit\4D Modelling Master (with Macros) .xlsm")
code_block_4 = CodeBlock { "Level_Construction_Seq"; 1; 0; false; true; }
categories_2 = Categories("OST_Levels")
all_elements_of_category_3 = ElementsOfCategory(Category=categories_2)
name = Level.Name(level=all_elements_of_category_3)
exportToExcel_3 = Data.ExportToExcel(filePath=file_path_3, sheetName=code_block_4.out0, startRow=code_block_4.out1, startColumn=code_block_4.out2, data=name, overWrite=code_block_4.out3, writeAsString=code_block_4.out4)
