# Dynamo graph 4. Construction Sequencing.dyn (Dynamo 2.18.1.5096)

# group: Assigns Construction Zone Sequence Values
string = StringInput("Parts")
byName = Category.ByName(name=string)
all_elements_of_category = ElementsOfCategory(Category=byName)
code_block = CodeBlock { "Construction_Zone_Sequence"; }
file_path = Filename("..\Revit\4D Modelling Master (with Macros) .xlsm")
file_from_path = FileObject(path=file_path)
code_block_2 = CodeBlock { "Construction_Zone_Seq"; }
boolean = BoolSelector(true)
boolean_2 = BoolSelector(false)
importExcel = Data.ImportExcel(file=file_from_path, sheetName=code_block_2, readAsStrings=boolean, showExcel=boolean_2)
restOfItems = List.RestOfItems(list=importExcel)
transpose = List.Transpose(lists=restOfItems)
code_block_3 = CodeBlock { 0; }
getItemAtIndex = List.GetItemAtIndex(list=transpose, index=code_block_3)
code_block_4 = CodeBlock { 1; }
getItemAtIndex_2 = List.GetItemAtIndex(list=transpose, index=code_block_4)
byKeysValues = DesignScript.Builtin.Dictionary.ByKeysValues(keys=getItemAtIndex, values=getItemAtIndex_2)
code_block_5 = CodeBlock { "Construction_Zone"; }
getParameterValueByName = Element.GetParameterValueByName(element=all_elements_of_category, parameterName=code_block_5)
valueAtKey = DesignScript.Builtin.Dictionary.ValueAtKey(dictionary=byKeysValues, key=getParameterValueByName)
setParameterByName = Element.SetParameterByName(element=all_elements_of_category, parameterName=code_block, value=valueAtKey)

# group: Assigns Level Construction Sequence Values
string_2 = StringInput("Parts")
byName_2 = Category.ByName(name=string_2)
all_elements_of_category_2 = ElementsOfCategory(Category=byName_2)
code_block_6 = CodeBlock { "Level_Construction_Sequence"; }
file_path_2 = Filename("..\Revit\4D Modelling Master (with Macros) .xlsm")
file_from_path_2 = FileObject(path=file_path_2)
code_block_7 = CodeBlock { "Level_Construction_Seq"; }
boolean_3 = BoolSelector(true)
boolean_4 = BoolSelector(false)
importExcel_2 = Data.ImportExcel(file=file_from_path_2, sheetName=code_block_7, readAsStrings=boolean_3, showExcel=boolean_4)
restOfItems_2 = List.RestOfItems(list=importExcel_2)
transpose_2 = List.Transpose(lists=restOfItems_2)
code_block_8 = CodeBlock { 0; }
getItemAtIndex_3 = List.GetItemAtIndex(list=transpose_2, index=code_block_8)
code_block_9 = CodeBlock { 1; }
getItemAtIndex_4 = List.GetItemAtIndex(list=transpose_2, index=code_block_9)
byKeysValues_2 = DesignScript.Builtin.Dictionary.ByKeysValues(keys=getItemAtIndex_3, values=getItemAtIndex_4)
code_block_10 = CodeBlock { "Base Level"; }
getParameterValueByName_2 = Element.GetParameterValueByName(element=all_elements_of_category_2, parameterName=code_block_10)
name = Level.Name(level=getParameterValueByName_2)
valueAtKey_2 = DesignScript.Builtin.Dictionary.ValueAtKey(dictionary=byKeysValues_2, key=name)
setParameterByName_2 = Element.SetParameterByName(element=all_elements_of_category_2, parameterName=code_block_6, value=valueAtKey_2)

# group: Assigns Element Construction Sequence Values
string_3 = StringInput("Parts")
byName_3 = Category.ByName(name=string_3)
all_elements_of_category_3 = ElementsOfCategory(Category=byName_3)
code_block_11 = CodeBlock { "Element_Construction_Sequence"; }
file_path_3 = Filename("..\Revit\4D Modelling Master (with Macros) .xlsm")
file_from_path_3 = FileObject(path=file_path_3)
code_block_12 = CodeBlock { "Model_Elements_Seq"; }
boolean_5 = BoolSelector(true)
boolean_6 = BoolSelector(false)
importExcel_3 = Data.ImportExcel(file=file_from_path_3, sheetName=code_block_12, readAsStrings=boolean_5, showExcel=boolean_6)
restOfItems_3 = List.RestOfItems(list=importExcel_3)
transpose_3 = List.Transpose(lists=restOfItems_3)
code_block_13 = CodeBlock { 0; }
getItemAtIndex_5 = List.GetItemAtIndex(list=transpose_3, index=code_block_13)
code_block_14 = CodeBlock { 1; }
getItemAtIndex_6 = List.GetItemAtIndex(list=transpose_3, index=code_block_14)
byKeysValues_3 = DesignScript.Builtin.Dictionary.ByKeysValues(keys=getItemAtIndex_5, values=getItemAtIndex_6)
code_block_15 = CodeBlock { "Classification_Uniclass_Description"; }
getParameterValueByName_3 = Element.GetParameterValueByName(element=all_elements_of_category_3, parameterName=code_block_15)
valueAtKey_3 = DesignScript.Builtin.Dictionary.ValueAtKey(dictionary=byKeysValues_3, key=getParameterValueByName_3)
setParameterByName_3 = Element.SetParameterByName(element=all_elements_of_category_3, parameterName=code_block_11, value=valueAtKey_3)
