# Dynamo graph 5. Automatic Parting of Slabs!.dyn (Dynamo 2.19.3.6394)
# packages: Rhythm 2023.9.1, GenerativeDesign.Revit 6.0.2.0

select_multiple_model_elements = DSModelElementMutlipleSelection()  # 5 picked in the model
select_face = DSFaceSelection()  # 1 picked in the model
byJoinedSurfaces = PolySurface.ByJoinedSurfaces(surfaces=select_face)
perimeterCurves = Surface.PerimeterCurves(surface=byJoinedSurfaces)
endPoint = Curve.EndPoint(curve=perimeterCurves)
startPoint = Curve.StartPoint(curve=perimeterCurves)
byStartPointEndPoint = ReferencePlane.ByStartPointEndPoint(start=endPoint, end=startPoint)
ʳʰʸᵗʰᵐ_parts_divideparts = Rhythm.Revit.Elements.Parts.DivideParts(part=select_multiple_model_elements, referencePlane=byStartPointEndPoint)
curve = Grid.Curve()  # unwired: grid
byLine = ReferencePlane.ByLine(line=curve)
